# Grasshopper definition 260317_sandbox.ghx (Grasshopper 1.0.8)

# ----
# SetUp
# Import
# Import modules from compas_rhino
toggle = BooleanToggle(True)
trigger = Trigger(Interval=50, TimerInterval=50, Target=py3)  # disabled
py3 = Python3Script(reload=toggle)  # -> out
# ---------- py3: Python ----------
if reload:
    from compas_rhino import unload_modules
    unload_modules("fabrication_manager")
    unload_modules("am_information_model")
    unload_modules('mobile_robot_control')
    unload_modules('mobile_part_based_am')
    unload_modules('ur_fabrication_control')
    unload_modules('slab_net_zero')
# ---------- end py3 ----------
panel = Panel(py3)

panel_2 = Panel("Import ROS_client")
list = ValueList({"local": "127.0.0.1", "linux computer": "192.168.0.42", "linux eduroam": "10.181.95.254", "linux ccnet": "192.168.0.102", "linux vmware": "192.168.199.36", "robot": "192.168.0.200", "robotAA_wifi": "192.168.0.111", "robotAB_wifi": "192.168.0.112", "robotAB_eduroam": "10.181.67.95"}, selected="local")
# Robot fit out
connect = BooleanToggle(True)
ros = Python3Script(ip=list, port="9090", connect=connect)  # -> out, ros_client, is_connected; inputs ip: String, port: Int32, connect: Boolean
# ---------- ros: Python ----------
from mobile_robot_sandbox.load_robot.connect_ros import connect_ros

ros_client, is_connected = connect_ros(connect, ip, port)
# ---------- end ros ----------
panel_3 = Panel(ros.is_connected)

# ----
# Load Robot
toggle_2 = BooleanToggle(True)
mobile_robot = Python3Script(ros_client=ros.ros_client, load=toggle_2)  # -> out, mobile_robot; inputs prefix: String
# ---------- mobile_robot: Python ----------
from mobile_robot_sandbox.load_robot.load_robot import load_robot

mobile_robot = load_robot(ros_client, load, prefix)
# ---------- end mobile_robot ----------
info = Python3Script(robot=mobile_robot.mobile_robot)  # -> out, main_group_name
# ---------- info: Python ----------
from mobile_robot_sandbox.load_robot.robot_info import robot_info
main_group_name = robot_info(robot)
# ---------- end info ----------
panel_4 = Panel(info.out)
panel_5 = Panel(mobile_robot.mobile_robot)

# ----
# Mobile robot base position
filepath = FilePath("C:\Users\david\Documents\GitHub\slab_net_zero\data\segments\segment_4\BCF_lh299_2025-05-06.json")
py3_2 = Python3Script(filepath=filepath)  # -> out, robot_plane
# ---------- py3_2: Python ----------
from compas.geometry import Frame
from compas_rhino.conversions import frame_to_rhino_plane


robot_frame = Frame.from_json(filepath)
robot_plane = frame_to_rhino_plane(robot_frame)
# ---------- end py3_2 ----------
worldxy = BooleanToggle(False)
custom = Plane(py3_2.robot_plane)
py3_3 = Python3Script(robot=mobile_robot.mobile_robot, use_rhino_worldXY=worldxy, custom_plane=custom)  # -> out, base_plane, arm_base_plane; inputs custom_plane: Plane
# ---------- py3_3: Python ----------
from mobile_robot_sandbox.set_robot_base_plane.set_base import set_base
base_frame, base_plane, arm_base_plane = set_base(robot, use_rhino_worldXY, custom_plane)
# ---------- end py3_3 ----------

# ----
# Attach tool
list_2 = ValueList({"measurement_tool": 0, "measurement_toolx3": 1, "extruder_marker_tracking_FOV": 2, "extruder_marker_tracking": 3, "concrete_extruder_v1_10mm_0deg": 5, "earth_extruder_v1_15mm shorter": 6, "concrete_extruder_long_nozzle": 7, "concrete_extruder_10cm_90deg": 8, "concrete_extruder_90deg_measure": 9}, selected="concrete_extruder_10cm_90deg")
remove = Button()
update = Button()
show = BooleanToggle(True)
add = Button()
tool = Python3Script(robot=mobile_robot.mobile_robot, tool_id=list_2, show=show, attach=add, update=update, remove=remove)  # -> out, tool, visuals, collision, ee_plane, a
# ---------- tool: Python ----------
from mobile_robot_sandbox.attach_tool.attach_tool import attach_tool
tool, ee_plane, visuals, collision = attach_tool(tool_id, robot=robot, attach=attach, remove=remove, update=update, show=show)
# ---------- end tool ----------

# ----
# IP Settings
# —> Set user IP address
# —> Set robot IP address
server_ip = ValueList({"192.168.0.42", "192.168.0.43", "192.168.10.12", "192.168.10.11", "192.168.10.10", "192.168.10.2", "127.0.0.1", "192.168.10.111", "192.168.0.250", "192.168.0.30", "10.42.0.212", "10.42.0.133"}, selected="192.168.0.42")
ur_ip = ValueList({"192.168.10.10", "192.168.10.20", "192.168.10.11", "192.168.10.12", "127.0.0.1", "192.168.10.111", "192.168.0.210", "192.168.0.211", "192.168.0.30"}, selected="192.168.0.210")
server_port = ValueList({"50002", "50003", "50005", "50006", "50007", "50008", "50009", "50010", "50011", "50012", "50013", "50014", "50015", "50016", "50017", "50018", "50019", "50020", "50021", "50022", "50023", "50024", "50025", "50026", "50027", "50028"}, selected="50011")
ur_port = ValueList({"30002"}, selected="30002")
globals = Python3Script(server_ip=server_ip, server_port=server_port, ur_ip=ur_ip, ur_port=ur_port, clear=Button())  # inputs server_ip: String, server_port: Int32, ur_ip: String, ur_port: Int32
# ---------- globals: Python ----------
from scriptcontext import sticky as st

st["server_ip"] = server_ip
st["server_port"] = server_port

st["ur_ip"] = ur_ip
st["ur_port"] = ur_port


if clear:
    st.clear()
# ---------- end globals ----------

# ----
# select configuration
# set velocity
# SEND urscript to UR ports
send_print_layer = Data()  # disabled
list_3 = ValueList({"send one cartesian position": 0, "send all cartesian positions": 1, "send safe position": 2, "send print layer": 3}, selected="send one cartesian position")  # disabled
send_one_cartesian_pos = Data()  # disabled
send_all_cartesian_pos = Data()  # disabled
send_safe_position = Data()  # disabled
filter = StreamFilter(
    Gate=list_3,
    Stream0=send_one_cartesian_pos,
    Stream1=send_all_cartesian_pos,
    Stream2=send_safe_position,
    Stream3=send_print_layer)  # disabled
reload = Button()  # disabled
number_slider = Slider(0.03, range=0..0.5)  # disabled
radius = Slider(0.01, range=0..0.5)  # disabled
robot = Data()  # disabled
movel = Python3Script(robot=robot, planes_WCS=filter, velocity=number_slider, radius=radius, reload=reload)  # -> urscript, plane_RCS; inputs planes_WCS: list of Plane; disabled
# ---------- movel: Python ----------
import Rhino.Geometry as rg
from compas.geometry import Frame
from compas.geometry import Transformation, Rotation
from compas_rhino.conversions import plane_to_compas_frame, frame_to_rhino_plane
from compas_ghpython.drawing import draw_frame
from ur_fabrication_control import direct_control 
import math

from scriptcontext import sticky as st
from ur_fabrication_control.direct_control import URScript

# retrieve the current tool frame in axis angle format
if robot.attached_tool:
    tool_angle_axis = list(robot.attached_tool.frame.point) + list(robot.attached_tool.frame.axis_angle_vector)
else:
    tool0_frame = Frame([0, 0, 0], [1, 0, 0], [0, 1, 0])
    tool_angle_axis = list(tool0_frame.point) + list(tool0_frame.axis_angle_vector)

frames_RCS = []
for plane_WCS in planes_WCS:
    frame_WCS = plane_to_compas_frame(plane_WCS)
    # transform frame to robot coordinate system
    T = Transformation.from_change_of_basis(Frame.worldXY(), robot.RCF)
    frame_RCS = robot.from_WCF_to_RCF(frame_WCS)
    frames_RCS.append(frame_RCS)

plane_RCS = frame_to_rhino_plane(frame_RCS)

urscript = URScript()
urscript.start()
urscript.set_tcp(tool_angle_axis)
for frame_RCS in frames_RCS:
    if frame_RCS == frames_RCS[0]:
        urscript.move_linear(frame=frame_RCS, velocity=velocity, radius=radius)
    else:
        urscript.move_process(frame=frame_RCS, velocity=velocity, radius=radius)
urscript.end()

urscript = urscript.generate()

print(urscript)
# ---------- end movel ----------
send = Button()  # disabled
ur_send = Python3Script(urscript=movel.urscript, send=send)  # -> out; disabled
# ---------- ur_send: Python ----------
from scriptcontext import sticky as st
from ur_fabrication_control.direct_control import send_script

ur_ip = st["ur_ip"]
ur_port = st["ur_port"]

if send:
    send_script(urscript, ur_ip, ur_port)
# ---------- end ur_send ----------

# ---- group: save_paths
number_slider_2 = Slider(0, range=0..10)  # disabled
button = Button()  # disabled
savedirectory = Python3Script(segment_id=number_slider_2, create_dir=button)  # -> out, dir_exists, DATA, DIR; inputs segment_id: Int32; disabled
# ---------- savedirectory: Python ----------
import os

#package_path = os.path.dirname(mobile_fabrication_control.__file__)
#DATA = os.path.abspath(os.path.join(package_path,"../../data"))

package_path = ghdoc.Path
# package_path = os.path.dirname(ur_fabrication_control.__file__)
#DATA = os.path.abspath(os.path.join(package_path,"../../data"))

# .stl files not stored in am_hackathon repo. but in mobile_fabrication_control
DATA = os.path.abspath(os.path.join(package_path,"../../data"))

DIR = os.path.join(DATA, "segments", f"segment_{segment_id}")
print(DIR)
if os.path.isdir(DIR):
    dir_exists = "true"
else:
    dir_exists = "false"
    if create_dir:
        os.mkdir(DIR)
print(package_path)
print(DATA)
# ---------- end savedirectory ----------
panel_6 = Panel("ply")  # disabled
panel_7 = Panel("reference_points")  # disabled
panel_8 = Panel("measurements")  # disabled
panel_9 = Panel("ply")  # disabled
file = Python3Script(DIR=savedirectory.DIR, filename=panel_8, ext=panel_6)  # -> PATH; disabled
# ---------- file: Python ----------
import os
import datetime

date = today = datetime.date.today()
# print(date.year, date.month, date.day)

name = f"{filename}_{date}.{ext}"
PATH = os.path.join(DIR, name)
# ---------- end file ----------
panel_10 = Panel(file)  # disabled
file_2 = Python3Script(DIR=savedirectory.DIR, filename=panel_7, ext=panel_9)  # -> PATH; disabled; same code as file
panel_11 = Panel(file_2)  # disabled
panel_12 = Panel(savedirectory.dir_exists)  # disabled

# ---- group: fk and ik switched?
# Direct UR + Lift control
value_list = ValueList({"send fk configuration": 0, "send ik configuration": 1, "selected pose motion planning": 2}, selected="selected pose motion planning")  # disabled

# ----
# Check if UR robot is available
ping = Button()
py3_4 = Python3Script(ip=ur_ip, ping=ping)  # -> out; inputs ip: String
# ---------- py3_4: Python ----------
from scriptcontext import sticky as st
from ur_fabrication_control.direct_control.utilities import is_available

guid = str(ghenv.Component.InstanceGuid)
txt_key = "txt_" + guid
if txt_key not in st:
    st[txt_key] = ""

if ping:
    
    available = is_available(ip)
    
    if available:
        st[txt_key] = "%s is up!" % ip
        trigger = True
    else:
        st[txt_key] = "%s is down!" % ip
        trigger = False

print(st[txt_key])
# ---------- end py3_4 ----------
panel_13 = Panel(py3_4)

# ----
# analytic inverse kinematics
select_configuration = Slider(2, range=0..7)
plane = Plane(Plane(origin=(1.103623824, 0, 1.663513226), x=(0, 1, 0), y=(0.9806906575, 0, -0.1955654221)))
analytic_inverse = Python3Script(robot=mobile_robot.mobile_robot, lift=Slider(0, range=0..0.7), plane_WCS=plane, idx=select_configuration)  # -> out, configuration, plane_RCS, plane_tool0_RCS; inputs plane_WCS: Plane, idx: Int32
# ---------- analytic_inverse: Python ----------
from mobile_robot_sandbox.kinematics.inverse_kinematics import inverse_kinematics
configuration, plane_tool0_RCS, plane_RCS, solutions = inverse_kinematics(robot, plane_WCS, lift, idx)
# ---------- end analytic_inverse ----------

# ----
# forward kinematics
number_slider_3 = Slider(0, range=0..0.7)
forward_kinematics = Python3Script(
    robot=mobile_robot.mobile_robot,
    lift=number_slider_3,
    j1=Slider(0, range=-180..180),
    j2=Slider(0, range=-270..150),
    j3=Slider(0, range=-180..180),
    j4=Slider(0, range=-400..400),
    j5=Slider(0, range=-125..120),
    j6=Slider(0, range=-400..400))  # -> configuration
# ---------- forward_kinematics: Python ----------
from mobile_robot_sandbox.kinematics.forward_kinematics import forward_kinematics
configuration = forward_kinematics(robot, lift, j1, j2, j3, j4, j5, j6)
# ---------- end forward_kinematics ----------

# ----
# set configuration
list_4 = ValueList({"0 zero_configuration": 0, "1 forward_kinematics": 1, "2 inverse_kinematics": 2, "3 motion_planning": 3, "4 cartesian_motion_planning": 4, "5 travel_move": 5}, selected="1 forward_kinematics")
zero_config = Data(null)
forward_kinematics_2 = Data(forward_kinematics)
inverse_kinematics = Data(analytic_inverse.configuration)
filter_2 = StreamFilter(Gate=list_4, Stream0=zero_config, Stream1=forward_kinematics_2, Stream2=inverse_kinematics)

# ----
# Move joints
# Get pose joint
# Move cartesian
# Get pose cartesian
send_2 = Button()  # disabled

# ----
# select configuration
# set velocity
# SEND urscript to UR ports
cartesian_motion_plannning = Data()  # disabled
forward_kinematics_3 = Data(forward_kinematics)  # disabled
inverse_kinematics_2 = Data(analytic_inverse.configuration)  # disabled
number_slider_4 = Slider(0.079, range=0..0.5)  # disabled
filter_3 = StreamFilter(Gate=value_list, Stream0=forward_kinematics_3, Stream1=inverse_kinematics_2, Stream2=cartesian_motion_plannning)  # disabled
movej = Python3Script(configurations=filter_3, velocity=number_slider_4)  # -> urscript, lift, values; inputs configurations: list; disabled
# ---------- movej: Python ----------
from ur_fabrication_control.direct_control import URScript
from compas_robots import Configuration
import math

urscript = URScript()
urscript.start()
for configuration in configurations:
    joint_configuration = Configuration.from_revolute_values(configuration.revolute_values)
    print(joint_configuration)
    lift = configuration
    urscript.move_joint(joint_configuration, velocity)
urscript.end()

urscript = urscript.generate()

print(urscript)
# ---------- end movej ----------
ur_send_2 = Python3Script(urscript=movej.urscript, send=send_2)  # -> out; disabled
# ---------- ur_send_2: Python ----------
from scriptcontext import sticky as st
from ur_fabrication_control.direct_control import send_script

ur_ip = st["ur_ip"]
ur_port = st["ur_port"]

print(urscript)

if send:
    send_script(urscript, ur_ip, ur_port)
# ---------- end ur_send_2 ----------

relay = Relay()  # disabled

save_to_file = Button()  # disabled
reference_points = Point([<point referenced from the Rhino model> x5])  # disabled
filepath_2 = FilePath("C:\Users\david\Documents\GitHub\slab_net_zero\data\segments\segment_8\reference_points.ply")  # disabled

# ----
# Point measuring
# Get Pose Cartesian
get = Button()  # disabled
pose = Python3Script(get=get)  # -> out, pose_cartesian; disabled
# ---------- pose: Python ----------
from scriptcontext import sticky as st

from ur_fabrication_control.direct_control.common import get_current_pose_cartesian
from compas.geometry import Frame


server_ip = st["server_ip"]
server_port = st["server_port"]
ur_port = st["ur_port"]
ur_ip = st["ur_ip"]
pose_cartesian_meter = []
print (ur_ip)

# retrieve the current tool frame in axis angle format
if robot.attached_tool:
    print ("attached")
    tool_angle_axis = list(robot.attached_tool.frame.point) + list(robot.attached_tool.frame.axis_angle_vector)
    
else:
    tool0_frame = Frame([0, 0, 0], [1, 0, 0], [0, 1, 0])
    tool_angle_axis = list(tool0_frame.point) + list(tool0_frame.axis_angle_vector)

guid = str(ghenv.Component.InstanceGuid)
pose_cartesian_key = "pose_cartesian" + guid


if get:
    print ("getting pose")
    st[pose_cartesian_key] = get_current_pose_cartesian(tool_angle_axis, server_ip, server_port, ur_ip, ur_port, send=True)
    

if pose_cartesian_key not in st:
    pose_cartesian = []
else:
    pose_cartesian = st[pose_cartesian_key]
# ---------- end pose ----------
panel_14 = Panel(pose.out)  # disabled
record = Button()  # disabled
clear = Button()  # disabled
rec = Python3Script(msg=pose.pose_cartesian, rec=record, clear=clear)  # -> out, record, planes; inputs msg: list; disabled
# ---------- rec: Python ----------
from scriptcontext import sticky as st
from compas.geometry import Frame
from compas_rhino.conversions import frame_to_rhino_plane

guid = str(ghenv.Component.InstanceGuid)
recorded_key =  "recorded_" + guid

if recorded_key not in st:
    st[recorded_key] = []

if clear:
    st[recorded_key] = []
else:
    if len(msg):
        if msg != [None] and rec:
            st[recorded_key].append(msg)


record = st[recorded_key]
planes = []
for pose in st[recorded_key]:
    frame = Frame.from_axis_angle_vector(pose[3:6], pose[0:3])
    planes.append(frame_to_rhino_plane(frame))
print (rec)
# ---------- end rec ----------
panel_15 = Panel(rec.record)  # disabled

list_5 = ValueList({"get_pose_cartesian": 0, "manual_input": 1, "from_file": 2}, selected="get_pose_cartesian")  # disabled
save_to_file_2 = Button()  # disabled
pose_cartesian_planes = Point(rec.planes)  # disabled
manual_points = Point([<point referenced from the Rhino model> x5])  # disabled
filepath_3 = FilePath("C:\Users\david\Documents\GitHub\slab_net_zero\data\segments\segment_8\measurements_lift030.ply")  # disabled

filepath_4 = FilePath("C:\Users\david\Documents\GitHub\slab_net_zero\data\segments\segment_8\measurements_lift070.ply")  # disabled
# |    STOP
stop = Button()  # disabled

filter_4 = StreamFilter(Gate=list_5, Stream0=pose_cartesian_planes, Stream1=manual_points)  # disabled
equals = Equality(FirstNumber=list_5, SecondNumber=2)  # -> Equality, Inequality; disabled
points_to_pcd = Python3Script(points=filter_4, filepath=file, write=save_to_file_2)  # -> out, pcd; inputs points: list of Point3d; disabled
# ---------- points_to_pcd: Python ----------
import open3d

array = [[x,y,z] for x, y, z in iter(points)]
pcd = open3d.geometry.PointCloud()
pcd.points = open3d.utility.Vector3dVector(array)
pcd.voxel_down_sample(0.0001)


if write:
    open3d.io.write_point_cloud(filepath, pcd, write_ascii=True)
    print("file written to ", str(filepath))
# ---------- end points_to_pcd ----------
pcd_from_file = Python3Script(filepath=filepath_4, read=equals.Equality)  # -> out, pcd; disabled
# ---------- pcd_from_file: Python ----------
from compas.datastructures import Mesh
from compas.files import PLY, STL
import os
import open3d

# filepath = os.path.join(data, filename)

if read:
    pcd = open3d.io.read_point_cloud(filepath)
    print("file read from ", str(filepath))
# ---------- end pcd_from_file ----------
filter_5 = StreamFilter(Gate=list_5, Stream0=points_to_pcd.pcd, Stream1=points_to_pcd.pcd, Stream2=pcd_from_file.pcd)  # disabled
measurements_source = Data(filter_5)  # disabled

points_to_pcd_2 = Python3Script(points=reference_points, filepath=file_2, write=save_to_file)  # -> out, pcd; inputs points: list of Point3d; disabled; same code as points_to_pcd
reference_target = Data(points_to_pcd_2.pcd)  # disabled

get_2 = Button()  # disabled
robot_2 = Data()  # disabled
pose_2 = Python3Script(robot=robot_2, get=get_2)  # -> out, configuration, pose_joints; disabled
# ---------- pose_2: Python ----------
from scriptcontext import sticky as st
from ur_fabrication_control.direct_control.common import get_current_pose_joints
from compas.geometry import Frame
from compas_robots import Configuration


robot = st["robot"]

server_ip= st["server_ip"]
server_port = st["server_port"]
ur_port = st["ur_port"]
ur_ip = st["ur_ip"]
print(ur_ip)

guid = str(ghenv.Component.InstanceGuid)
pose_joints_key = "pose_joints" + guid

if pose_joints_key not in st:
    st[pose_joints_key] = None

# retrieve the current tool frame in axis angle format
if robot.attached_tool:
    tool_angle_axis = list(robot.attached_tool.frame.point) + list(robot.attached_tool.frame.axis_angle_vector)
else:
    tool0_frame = Frame([0, 0, 0], [1, 0, 0], [0, 1, 0])
    tool_angle_axis = list(tool0_frame.point) + list(tool0_frame.axis_angle_vector)

print(tool_angle_axis)

# send script to the robot to receive the current joint configuration
if get:
    st[pose_joints_key] = get_current_pose_joints(server_ip, server_port, ur_ip, ur_port, tool_angle_axis)

if st[pose_joints_key] is not None:
    print(st[pose_joints_key])
    configuration = Configuration.from_revolute_values(st[pose_joints_key])
    pose_joints = configuration.joint_values
"""
if pose_joints_key not in st:
    configuration = Configuration.from_revolute_values([0,0,0,0,0,0])
else:
    configuration = Configuration.from_revolute_values(st[pose_joints_key])

pose_joints = configuration.values
"""
# ---------- end pose_2 ----------
panel_16 = Panel(pose_2.pose_joints)  # disabled

get_3 = Button()  # disabled
robot_3 = Data()  # disabled
pose_3 = Python3Script(robot=robot_3, get=get_3)  # -> out, pose_cartesian; disabled
# ---------- pose_3: Python ----------
from scriptcontext import sticky as st
#from ur_fabrication_control.online_control.ur_direct import get_current_pose_cartesian

from ur_fabrication_control.direct_control.common import get_current_pose_cartesian
from compas.geometry import Frame
from compas_ghpython import draw_frame


server_ip = st["server_ip"]
server_port = st["server_port"]
ur_port = st["ur_port"]
ur_ip = st["ur_ip"]
pose_cartesian_meter = []

# retrieve the current tool frame in axis angle format
if robot.attached_tool:
    print("attached")
    tool_angle_axis = list(robot.attached_tool.frame.point) + list(robot.attached_tool.frame.axis_angle_vector)
    
else:
    tool0_frame = Frame([0, 0, 0], [1, 0, 0], [0, 1, 0])
    tool_angle_axis = list(tool0_frame.point) + list(tool0_frame.axis_angle_vector)

guid = str(ghenv.Component.InstanceGuid)
pose_cartesian_key = "pose_cartesian" + guid

if pose_cartesian_key not in st:
    st[pose_cartesian_key] = None

if get:
    print("getting pose")
    st[pose_cartesian_key] = get_current_pose_cartesian(tool_angle_axis, server_ip, server_port, ur_ip, ur_port, send=True)
    
pose_cartesian = st[pose_cartesian_key]
# ---------- end pose_3 ----------
rec_2 = DataRecorder(pose_3.out, DataLimit=-10, RecordData=False)  # disabled
python = Python3Script(robot=robot_3, pose=pose_3.pose_cartesian)  # -> out, plane_RCS, plane_WCS; inputs pose: list; disabled
# ---------- python: Python ----------
__author__ = "Gido"
__version__ = "2023.07.05"

import rhinoscriptsyntax as rs
from compas.geometry import Frame
from compas_ghpython import draw_frame
from compas.geometry import Transformation

if pose is not None:
    frame_RCS = Frame.from_axis_angle_vector(pose[3:6], pose[0:3])
    T = Transformation.from_change_of_basis(robot.RCF, Frame.worldXY())
    frame_BCS = frame_RCS.transformed(T)
    frame_WCS = robot.from_BCF_to_WCF(frame_BCS)
    plane_BCS = draw_frame(frame_BCS)
    plane_WCS = draw_frame(frame_WCS)
# ---------- end python ----------
panel_17 = Panel(rec_2)  # disabled
pln = Plane(python.plane_WCS)  # disabled

X = Python3Script(stop=stop)  # disabled
# ---------- X: Python ----------
from scriptcontext import sticky as st
from ur_fabrication_control.direct_control.common import send_stop

ur_ip = st["ur_ip"]
ur_port = st["ur_port"]

if stop:
    send_stop(ur_ip, ur_port)
# ---------- end X ----------
py3_5 = Python3Script(pcd=points_to_pcd.pcd)  # -> out, points; disabled
# ---------- py3_5: Python ----------
import Rhino.Geometry as rg

points = [rg.Point3d(*pt) for pt in pcd.points]
# ---------- end py3_5 ----------

measurements_source_2 = Data(measurements_source)  # disabled
reference_target_2 = Data(reference_target)  # disabled

number_slider_5 = Slider(0.25, range=0..10)  # disabled

# ----
# RANSAC Global registration
toggle_3 = BooleanToggle(True)  # disabled
ransac = Python3Script(source=measurements_source_2, target=reference_target_2, threshold=number_slider_5, compute=toggle_3)  # -> out, source_out, target_out, source_at_target, plane_out, T_RANSAC; disabled
# ---------- ransac: Python ----------
from compas.geometry import Transformation

import open3d as o3d
import Rhino.Geometry as rg

from compas.geometry import Point, Frame
from compas_rhino.conversions import point_to_rhino, frame_to_rhino_plane

from mobile_robot_control.pointcloud_processing.ransac import preprocess_point_cloud_global, execute_global_registration2

if compute: 
    source, source_fpfh = preprocess_point_cloud_global(source, threshold)
    target, target_fpfh = preprocess_point_cloud_global(target, threshold)

    result_ransac = execute_global_registration2(source, target,
                                                source_fpfh, target_fpfh,
                                                threshold)
    print(result_ransac)

    T_RANSAC = Transformation.from_matrix(list(result_ransac.transformation))
    print(T_RANSAC)
    source_out = [rg.Point3d(*pt) for pt in source.points]
    target_out = [rg.Point3d(*pt) for pt in target.points]
    source_at_target = [point_to_rhino(Point(*pt).transformed(T_RANSAC)) for pt in source.points]
    frame_out = Frame.worldXY().transformed(T_RANSAC)
    plane_out = frame_to_rhino_plane(frame_out)
# ---------- end ransac ----------
panel_18 = Panel(ransac.out)  # disabled
number_slider_6 = Slider(0.1, range=0..0.1)  # disabled
swatch = ColourSwatch(SwatchColor=RGB(255, 0, 0))  # disabled
swatch_2 = ColourSwatch(SwatchColor=RGB(0, 204, 255))  # disabled
measured = DotDisplay(Point=ransac.source_out, Colour=swatch_2, Size=number_slider_6)  # disabled
target = DotDisplay(Point=ransac.target_out, Colour=swatch, Size=number_slider_6)  # disabled

swatch_3 = ColourSwatch(SwatchColor=RGB(255, 144, 0))  # disabled
dots = DotDisplay(Point=ransac.source_at_target, Colour=swatch_3, Size=number_slider_6)  # disabled

# ----
# Visualise
configuration = Data(filter_2)
show_frames = BooleanToggle(True)
show_visual = BooleanToggle(True)
show_collision = BooleanToggle(True)
show_base_frame = BooleanToggle(True)
show_end_effector_frame = BooleanToggle(False)
show_acm = BooleanToggle(True)
robot_4 = Data(mobile_robot.mobile_robot)
visualise = Python3Script(
    robot=robot_4,
    configuration=configuration,
    show_frames=show_frames,
    show_visual_meshes=show_visual,
    show_collision_meshes=show_collision,
    show_base_frame=show_base_frame,
    show_end_effector_frame=show_end_effector_frame,
    show_attached_collision_meshes=show_acm,
    reload=Button())  # -> out, joint_planes, visual_meshes, collision_meshes, base_plane, end_effector_plane, attched_collision_meshes
# ---------- visualise: Python ----------
from mobile_robot_sandbox.visualize.visualize import visualize
joint_planes, base_plane, end_effector_plane, visual_meshes, collision_meshes, attached_collision_meshes = visualize(robot, configuration, show_frames, show_base_frame, show_end_effector_frame, show_visual_meshes, show_collision_meshes, show_attached_collision_meshes)
# ---------- end visualise ----------
pln_2 = Plane(visualise.joint_planes)
mesh = Mesh(visualise.visual_meshes)
mesh_2 = Mesh(visualise.collision_meshes)
pln_3 = Plane(visualise.base_plane)
pln_4 = Plane(visualise.end_effector_plane)
preview = CustomPreview(Geometry=mesh, Material=ColourSwatch(SwatchColor=RGB(125, 125, 125)))

# ----
# ICP
toggle_4 = BooleanToggle(True)  # disabled
number_slider_7 = Slider(0.05, range=0..1)  # disabled
icp = Python3Script(
    source=measurements_source_2,
    target=reference_target_2,
    initial_guess=ransac.plane_out,
    threshold=number_slider_7,
    compute=toggle_4)  # -> out, source_out, target_out, source_at_target, plane_out, T_ICP; disabled
# ---------- icp: Python ----------
from compas.geometry import Point, Frame, Transformation
from compas_rhino.conversions import point_to_rhino, frame_to_rhino_plane
import Rhino.Geometry as rg

from mobile_robot_control.pointcloud_processing.icp import preprocess_point_cloud_icp, evaluate_local_registration, execute_icp_local_registration

# source_down = preprocess_point_cloud_icp(source, voxel_size)
# target_down = preprocess_point_cloud_icp(target, voxel_size)

trans_init, evaluation = evaluate_local_registration(source, target, threshold, initial_guess)
print(evaluation)

if compute:
    registration_icp = execute_icp_local_registration(source, target, threshold, trans_init)

    print("Inlier Fitness: ", registration_icp.fitness)
    print("Inlier RMSE: ", registration_icp.inlier_rmse)

    print("Transformation: \n", registration_icp.transformation)

source_out = [rg.Point3d(*pt) for pt in source.points]
target_out = [rg.Point3d(*pt) for pt in target.points]
T_ICP = Transformation.from_matrix(list(registration_icp.transformation))
source_at_target = [point_to_rhino(Point(*pt).transformed(T_ICP)) for pt in source.points]
frame_out = Frame.worldXY().transformed(T_ICP)
plane_out = frame_to_rhino_plane(frame_out)
# ---------- end icp ----------
panel_19 = Panel(icp.out)  # disabled

number_slider_8 = Slider(0.1, range=0..0.1)  # disabled
swatch_4 = ColourSwatch(SwatchColor=RGB(255, 0, 0))  # disabled
swatch_5 = ColourSwatch(SwatchColor=RGB(0, 204, 255))  # disabled
swatch_6 = ColourSwatch(SwatchColor=RGB(255, 144, 0))  # disabled

# ----
# end effector & joint planes
number_slider_9 = Slider(0.2, range=0..1)
py3_6 = Python3Script(planes=[visualise.joint_planes, visualise.end_effector_plane], scale=number_slider_9)  # -> P, V, C, W; inputs planes: list of Plane, scale: Double
# ---------- py3_6: Python ----------
from Rhino.Display import ColorRGBA
from ghpythonlib.components import ColourRGBf


red = ColourRGBf(255, 255, 0, 0)
green = ColourRGBf(255, 0, 255, 0)
blue = ColourRGBf(255, 0, 0, 255)

P = []
V = []
C = []

# scale = float(scale)

for plane in planes:
    if not plane:
        continue
    P += [plane.Origin] * 3
    V.append(plane.XAxis * scale)
    V.append(plane.YAxis * scale)
    V.append(plane.ZAxis * scale)
    C += [red, green, blue]

W = 3
# ---------- end py3_6 ----------
vdisex = VectorDisplayEx(Point=py3_6.P, Vector=py3_6.V, Colour=py3_6.C, Width=py3_6.W)

dots_2 = DotDisplay(Point=icp.source_out, Colour=swatch_5, Size=number_slider_8)  # disabled
dots_3 = DotDisplay(Point=icp.target_out, Colour=swatch_4, Size=number_slider_8)  # disabled
dots_4 = DotDisplay(Point=icp.source_at_target, Colour=swatch_6, Size=number_slider_8)  # disabled
lift_height_at_measuring = Panel("0.6990012765957446")  # disabled
lift_height_at_measuring_2 = Panel("0.6983774468085105")  # disabled
lift_height_at_measuring_3 = Panel("0.29943829787234044")  # disabled

# ----
# Robot plane
pln_5 = Plane(icp.plane_out)  # disabled

panel_20 = Panel("0.499375744680851")  # disabled
panel_21 = Panel("endcap_")  # disabled

# ----
# BCF from RCF (measured)
py3_7 = Python3Script(lift=lift_height_at_measuring_3, robot_plane=pln_5)  # -> out, RCF, RCF0, BCF, RCP, robot_BCP; inputs lift: Double, robot_plane: Plane; disabled
# ---------- py3_7: Python ----------
from compas.geometry import Transformation, Translation
from compas.geometry import Frame, Vector
from compas_rhino.conversions import plane_to_compas_frame, frame_to_rhino_plane

import ghpythonlib.components as ghcomp
import Rhino.Geometry as rg


#### This was annoying....
# Frames are always transforming in Global worldXY, if you want the transformation locally, this is the way >>>

## Normal RCF (no lift)
RCF0 = robot.RCF 
## Adjusted RCF (with lift)
RCF = robot.RCF.translated([0,0,lift])

## Convert measured plane to COMPAS
robot_frame = plane_to_compas_frame(robot_plane)

''' OPTION A'''
## Get the BCF in local coordinates from RCF
# base = RCF.to_local_coordinates(Frame.worldXY())
## Get the BCF at the measured plane
# BCF = robot_frame.to_world_coordinates(base)

''' OPTION B'''
# Transformation of the RCF to the measured plane (also RCF)
T = Transformation.from_frame_to_frame(RCF, robot_frame)
# Transforming the robot_footprint(worldxy)
BCF = Frame.worldXY().transformed(T)

## Visualisation
RCP = frame_to_rhino_plane(RCF)
robot_BCP = frame_to_rhino_plane(BCF)
# ---------- end py3_7 ----------
pln_6 = Plane(py3_7.RCP)  # disabled
pln_7 = Plane(py3_7.robot_BCP)  # disabled
button_2 = Button()  # disabled
save_json = Python3Script(
    RCF=py3_7.RCF,
    RCF0=py3_7.RCF0,
    BCF=py3_7.BCF,
    lift_height=lift_height_at_measuring_3,
    filepath=savedirectory.DIR,
    suffix=panel_21,
    save=button_2)  # -> out, a; inputs lift_height: Double; disabled
# ---------- save_json: Python ----------
import os
import math
import datetime
from compas.data import Data
from compas_rhino.conversions import plane_to_compas_frame
today = datetime.date.today()

lift = int(round(lift_height*1000, ndigits=0))
print(lift)
if save:
    rcf_filepath = os.path.join(filepath, f"RCF_lh{lift}{suffix}_{today}.json")
    rcf0_filepath = os.path.join(filepath, f"RCF0_lh{lift}{suffix}_{today}.json")
    bcf_filepath = os.path.join(filepath, f"BCF_lh{lift}{suffix}_{today}.json")
    RCF.to_json(rcf_filepath, pretty=True)
    RCF0.to_json(rcf0_filepath, pretty=True)
    BCF.to_json(bcf_filepath, pretty=True)
# ---------- end save_json ----------
